# Grasshopper definition UnifyToolspace.gh (Grasshopper 0.9.76)
# plug-ins: Weaverbird

# ---- group: Get render meshes from rhinoobjects - would not waste time running on blocks, only use on non block rhinoobject list
mesh_display_pipeline = CSharpScript(enabled=Toggle(False))  # -> meshOut, guidOut, layerOut, rhObjOut; inputs enabled: Boolean
# ---------- mesh_display_pipeline: C# ----------
    if (enabled == true) {
      List<Rhino.Geometry.Mesh> meshList = new List<Rhino.Geometry.Mesh>();
      var meshSettings = Rhino.Geometry.MeshType.Default;
      Rhino.Geometry.Mesh[] meshArray;
      Rhino.DocObjects.Layer itemLayer;
      List<string> layerNames = new List<string>();
      List<Guid> objIds = new List<Guid>();
      objIds.Clear();
      List<Rhino.DocObjects.RhinoObject> rhObjs = new List<Rhino.DocObjects.RhinoObject>();

      foreach (Rhino.DocObjects.RhinoObject objectItem in Rhino.RhinoDoc.ActiveDoc.Objects) {


        // Add Meshes
        meshArray = objectItem.GetMeshes(meshSettings);
        foreach (Rhino.Geometry.Mesh meshItem in meshArray) {

          // This condition will prevent non meshable objects from returning any other values

          if (meshItem.IsValid == false) {
          }
          else {

            // Add Name
            rhObjs.Add(objectItem);

            // Add Guid
            objIds.Add(objectItem.Id);

            // Add Layer name
            var layInd = objectItem.Attributes.LayerIndex;
            itemLayer = RhinoDoc.ActiveDoc.Layers[layInd];

            layerNames.Add(itemLayer.Name);

          }
          meshList.Add(meshItem);
        }
      }
      // Return Meshes
      meshOut = meshList;

      // Return Layers
      layerOut = layerNames;

      // Return Guids
      guidOut = objIds;

      // Return Active Objects
      rhObjOut = rhObjs;
    }
# ---------- end mesh_display_pipeline ----------

# ----
# Think about using
# rendermesh
# instead of meshing
# within the obj exporter?
layer_listener = CSharpScript(enable=Toggle(True))  # -> out, A; inputs enable: Boolean; disabled
# ---------- layer_listener: C# ----------
    var count = 0;
    if (enable == true) {

      Dictionary<string,Rhino.DocObjects.RhinoObject[]> objdict = new Dictionary<string,Rhino.DocObjects.RhinoObject[]>();
      var layerlist = RhinoDoc.ActiveDoc.Layers.ToArray();
      List < Rhino.DocObjects.ObjRef > reflist = new List<Rhino.DocObjects.ObjRef>();
      string extension = ".obj";
      char c = (char) 34;

      foreach (Rhino.DocObjects.Layer layeritem in layerlist) {
        string layername = layeritem.Name;
        var layerobjs = RhinoDoc.ActiveDoc.Objects.FindByLayer(layeritem);
        objdict.Add(layername, layerobjs);
        string countstr = count.ToString();
        string selector = string.Concat("_-SelLayer ", c, layername, c);
        RhinoApp.RunScript(selector, false);

        var newlayername = layername.Replace(" ", string.Empty);
        string filePath = string.Concat(@"C:\Users\LJobson\Downloads\Unify\", newlayername);
        string script = string.Concat("_-Export ", filePath, extension, " y=y", " _Enter _Enter");
        RhinoApp.RunScript(script, false);

        RhinoApp.RunScript("_-SelNone", true);
      }

    }
# ---------- end layer_listener ----------
activedoc = CSharpScript()  # -> namedViews, activeCam, allViews; disabled
# ---------- activedoc: C# ----------
    var Views = Rhino.RhinoDoc.ActiveDoc.NamedViews;

    foreach (var View in Views)
    {
      namedViews = View.Name;

      var activeView = namedViews.ActiveViewport;
      var camLoc = activeView.CameraLocation;
      var camTar = activeView.CameraTarget;
      activeCam = camLoc;
    }

    //var activeView = Rhino.Display.RhinoView.ActiveViewport();
    //var camLoc = activeView.CameraLocation;
    //var camTar = activeView.CameraTarget;
# ---------- end activedoc ----------
timer = Timer(TimerInterval=100, Target=mesh_display_pipeline)

# ---- group: Gets active view and named views
timer_2 = Timer(TimerInterval=50, Target=named_views)
named_views = CSharpScript()  # -> Names, Locations, Directions, Lenses, Aspects
# ---------- named_views: C# ----------
    Rhino.DocObjects.Tables.NamedViewTable viewTable;

    // Collections

    List<String> viewNames = new List<String>();// List of View Names
    List<Rhino.Geometry.Point3d> camLocations = new List<Rhino.Geometry.Point3d>();// List of Camera Locations
    List<Rhino.Geometry.Vector3d> camDirections = new List<Rhino.Geometry.Vector3d>();// List of Camera Orientations
    List < double> lensLengths = new List<double>();// List of Lens Lengths
    List < double> viewAspects = new List<double>();// List of Viewport Aspect Ratios


    // Vars
    string viewName;
    double viewAspect;
    Rhino.Geometry.Point3d camLocation;
    Rhino.DocObjects.ViewportInfo viewPort;
    viewTable = Rhino.RhinoDoc.ActiveDoc.NamedViews;


    // Active Viewport

    Rhino.Display.RhinoView activeView = Rhino.RhinoDoc.ActiveDoc.Views.ActiveView;
    var activePort = activeView.ActiveViewport;
   
    viewName = "Active";
    viewNames.Add(viewName);

    camLocation = activePort.CameraLocation;
    camLocations.Add(camLocation);

    var camDir = activePort.CameraDirection;
    camDirections.Add(camDir);

    var lensLen = activePort.Camera35mmLensLength;
    lensLengths.Add(lensLen);

    viewAspect = activePort.ScreenPortAspect;
    viewAspects.Add(viewAspect);



    // Iterate through namedview table

    foreach (Rhino.DocObjects.ViewInfo viewInfo in viewTable) {

      viewName = viewInfo.Name;
      viewNames.Add(viewName);

      viewPort = viewInfo.Viewport;

      camLocation = viewPort.CameraLocation;
      camLocations.Add(camLocation);

      var camDirection = viewPort.CameraDirection;
      camDirections.Add(camDirection);

      var lensLength = viewPort.Camera35mmLensLength;
      lensLengths.Add(lensLength);

      viewAspect = viewPort.ScreenPortAspect;
      viewAspects.Add(viewAspect);
    }

    // Out

    Names = viewNames;
    Locations = camLocations;
    Directions = camDirections;
    Lenses = lensLengths;
    Aspects = viewAspects;
# ---------- end named_views ----------

# ----
number_slider = Slider(0, range=0..10)  # disabled
panel = Panel(named_views.Names)
panel_2 = Panel(named_views.Locations)
panel_3 = Panel(named_views.Directions)
panel_4 = Panel(named_views.Lenses)
panel_5 = Panel(named_views.Aspects)
mesh = Mesh()  # disabled
guids = Panel(mesh_display_pipeline.guidOut)
layers = Panel(mesh_display_pipeline.layerOut)
toggle = BooleanToggle(False)  # disabled
panel_6 = Panel("lon,lat")  # disabled
item = ListItem(List=activedoc.namedViews, Index=number_slider, Wrap=True)  # disabled

# ---- group: quick fix for welding...
wbjoin = WeaverbirdsJoinMeshesAndWeld(Mesh=mesh_display_pipeline.meshOut, Weld=False)  # disabled
lng = ListLength(List=wbjoin)  # disabled
series = Series(Start=0, Step=1, Count=lng)  # disabled
txt = Text(series)  # disabled

# ----
cameras = CSharpScript(UseActive=toggle, CharConvert=item)  # -> Out, Cameras, Characters; disabled
colliders = CSharpScript(Meshes=mesh)  # -> Out, Colliders; disabled
enviroment = CSharpScript(Location=panel_6)  # -> Out, A; disabled
pt = Point(panel_2)

# ---- group: Obj exporter - switch vertices to topo vertices
obj_exporter = CSharpScript(
    meshItem=mesh_display_pipeline.meshOut,
    guidIn=mesh_display_pipeline.guidOut,
    layerIn=mesh_display_pipeline.layerOut,
    docInfo=panel)  # -> flatten(A); inputs meshItem: Mesh, docInfo: String
# ---------- obj_exporter: C# ----------
    Rhino.Geometry.Point3d[] meshVerts;
    double meshX;
    double meshY;
    double meshZ;
    double normX;
    double normY;
    double normZ;
    double texX;
    double texY;
    string vertLine;
    string normLine;
    Rhino.Geometry.Collections.MeshFaceList faceList;
    string header = "# gh obj exporter by lj";
    List<string> lineList = new List<string>();
    List<int> fIndices = new List<int>();
    string faceLine;

    //Header
    lineList.Add(header);
    lineList.Add("# you can add document information into the header");
    lineList.Add(string.Concat("# Camera Name: ", docInfo));


  //Guid
  lineList.Add((string.Concat("g ", (guidIn.ToString()))));

  //Vertices
  meshVerts = meshItem.Vertices.ToPoint3dArray();
  foreach (Rhino.Geometry.Point3d meshVert in meshVerts) {
  meshX = meshVert.X;
  meshY = meshVert.Y;
  meshZ = meshVert.Z;
  vertLine = string.Concat("v ", meshX.ToString(), " ", meshZ.ToString(), " ", (0 - meshY).ToString());
  lineList.Add(vertLine);
}
    //Normals
    foreach (Rhino.Geometry.Vector3d meshNormal in meshItem.Normals) {
      normX = meshNormal.X;
      normY = meshNormal.Y;
      normZ = meshNormal.Z;
      normLine = string.Concat("vn ", normX.ToString(), " ", normY.ToString(), " ", normZ.ToString());
      lineList.Add(normLine);
    }
    //TexCoords
    foreach (Rhino.Geometry.Point2f texPoint in meshItem.TextureCoordinates) {
      texX = texPoint.X;
      texY = texPoint.Y;
      normLine = string.Concat("vt ", texX.ToString(), " ", texY.ToString());
      lineList.Add(normLine);
    }
    //Faces

    faceList = meshItem.Faces;
    foreach (Rhino.Geometry.MeshFace faceItem in faceList) {
      if (faceItem.IsQuad == false) {
        faceLine = string.Concat("f ", ((faceItem.C + 1).ToString()), " ", ((faceItem.B + 1).ToString()), " ", ((faceItem.A + 1).ToString()));
      } else {
        faceLine = string.Concat("f ", (faceItem.D + 1).ToString(), " ", (faceItem.C + 1).ToString(), " ", (faceItem.B + 1).ToString(), " ", (faceItem.A + 1).ToString());
        lineList.Add(faceLine);
      }
    }
    A = lineList;
# ---------- obj_exporter: C# additional code ----------
  /// I will migrate the loops above into separate classes below

  // string VertWrite
  // string TexWrite
  // string NormWrite
  // string ParamWrite
  // string FaceWrite
# ---------- end obj_exporter ----------

# ----
sph = Sphere(Base=pt, Radius=10)
line = LineSDL(Start=pt, Direction=panel_3, Length=100)
copy_data_to_notepad_and_save_as_obj = Panel(obj_exporter)
end = EndPoints(Curve=line)  # -> Start, End
vdis = VectorDisplay(Anchor=end.End, Vector=panel_3)
# Notes: better to have the obj exporter do a selall since GH components will iterate for every object loaded into it
# Notes: to do overrides - do a quick layer switch and swtich back? ask dave before doing anything too stupid
unify = BooleanToggle(False)  # disabled
# Notes: better to have the obj exporter do a selall since GH components will iterate for every object loaded into it
panel_7 = Panel("127.0.0.1")
toggle_2 = BooleanToggle(False)  # disabled
# Notes: this will be for colliders and special objects.
special_objects = CSharpScript(scriptEnabled=unify)  # -> out, A; inputs scriptEnabled: Boolean, Collders: Guid; disabled
# ---------- special_objects: C# ----------
    if (scriptEnabled == true)
    {
    }
# ---------- end special_objects ----------
scene = CSharpScript(scriptEnabled=unify)  # -> out, A; inputs scriptEnabled: Boolean, Characters: Guid; disabled; same code as special_objects
export_all_obj = CSharpScript(scriptEnabled=toggle_2)  # inputs scriptEnabled: Boolean; disabled
# ---------- export_all_obj: C# ----------
    string docName = Rhino.RhinoDoc.ActiveDoc.Name;
    string userName = System.Environment.UserName;
    var split = docName.Split('.', '_', ' ');

    if (scriptEnabled == true)
    {
      string dirPath = string.Concat(@"C:\Users\", userName, @"\AppData\Roaming\Unify\");
      DirectoryInfo dirInfo = Directory.CreateDirectory(dirPath);
      string filePath = string.Concat(dirPath, split[0], "Konrad");
      string extension = ".obj";
      string script = string.Concat("_-Export ", filePath, extension, " y=y", " _Enter _Enter");

      //Rhino.RhinoDoc.ActiveDoc.Objects.Select(inputObjects);

      RhinoApp.RunScript("_-SelAll", false);
      RhinoApp.RunScript(script, false);
      RhinoApp.RunScript("_-SelNone", true);
    }
# ---------- end export_all_obj ----------
tcp_sender = CSharpScript(Ip=panel_7, Port="8002", Timeout="10000", Send=Toggle(False), line="Stream this")  # -> A; inputs Ip: String, Port: Int32, Timeout: Int32, Send: Boolean; disabled
# ---------- tcp_sender: C# ----------
    //this.Components = new List<object>();
    //DA.GetDataList<object>("Components", this.Components);
    //GH_Boolean update = new GH_Boolean(true);
    //GH_Boolean erase = new GH_Boolean(false);
    //DA.GetData<GH_Boolean>("Update", ref update);
    //DA.GetData<GH_String>("IP", ref this.Ip);
    //DA.GetData<GH_Integer>("Port", ref this.Port);
    //DA.GetData<GH_Integer>("TimeOut", ref this.Timeout);
    //GH_Boolean send = new GH_Boolean();
    //DA.GetData<GH_Boolean>("Send", ref send);
    //DA.GetData<GH_Boolean>("Erase", ref erase);
    Erase = erase.Value;
    Update = update.Value;
    //H_Number scale = new GH_Number(3.28084); // Rhino to Revit conversion factor
    //DA.GetData<GH_Number>("Scale", ref scale);
    //this.Scale = scale.Value;

    if (send == true)
    {
      //this.Icon = Properties.Resources.paper_airplane_red; // Looks like the icon changes when enabled to show that it is sending
      //this.DestroyIconCache(); // Something related to the above
      Grasshopper.Instances.RedrawAll(); // Probably a measure of good practice
      bool retry = true;
      string responseData = "";

      try
      {
        while (retry)
        {
          using (TcpClient tcpClient = new TcpClient())
          {

            tcpClient.Connect(IPAddress.Parse(Ip.Value), Port.Value);
            tcpClient.NoDelay = true;
            tcpClient.ReceiveTimeout = Timeout.Value;
            tcpClient.SendTimeout = Timeout.Value;

            using (NetworkStream stream = tcpClient.GetStream())
            {
              using (StreamWriter writer = new StreamWriter(stream, new UTF8Encoding(false)))
              {
                writer.AutoFlush = true;
                using (StreamReader reader = new StreamReader(stream))
                {
                  // Here's where the magic happens:

                  //string line = ComponentsToString(this.Components); // Send string of object list
                  writer.WriteLine(line);

                  string response = reader.ReadLine();
                  if (response == line) retry = false;
                  responseData = reader.ReadLine();
                }
              }
            }

          }
        }

      }
      catch (Exception ex)
      {
        this.AddRuntimeMessage(GH_RuntimeMessageLevel.Error, ex.Message);
      }

      try
      {
        if (responseData != "")
        {
          // Some serialization happening here
          var Collection = Deserialize(responseData, typeof(RevitFamilyCollection));
        }

      }
      catch (Exception ex)
      {

      }

      //this.Icon = Properties.Resources.paper_airplane_green;
      //this.DestroyIconCache();
      Grasshopper.Instances.RedrawAll();


    }

    //DA.SetDataList("Categories", revitFamilyCollection.Categories);
# ---------- tcp_sender: C# additional code ----------
  #region Serialization

  public static object Deserialize(string xml, Type toType)
  {
    using (Stream stream = new MemoryStream())
    {
      byte[] data = System.Text.Encoding.UTF8.GetBytes(xml);
      stream.Write(data, 0, data.Length);
      stream.Position = 0;
      System.Runtime.Serializiation.DataContractSerializer deserializer = new   System.Runtime.Serializiation.DataContractSerializer(toType);
      return deserializer.ReadObject(stream);
    }
  }

  #endregion

  public class Data
  {
    [DataMember]
    public List<> Categories;
  }

  /// <summary>
  /// Revit Family Identifier
  /// </summary>
  [DataContract]

  public class RevitFamily
  {
    [DataMember]
    public string Name;
    [DataMember]
    public List<string> Types;

    public override string ToString()
    {
      return Name;
    }
  }
# ---------- end tcp_sender ----------
get_blocks = CSharpScript()  # -> Out, A; disabled
